# Grasshopper definition process_trees.gh (Grasshopper 1.0.7)
# plug-ins: Mesh Pipe

# ----
# Canvas colours
boolean_toggle = BooleanToggle(False)
canvas_colours = PythonScript(
    Monochrome=boolean_toggle,
    CanvasColour=ColourSwatch(SwatchColor=RGB(255, 255, 255)),
    CanvasEdge=ColourSwatch(SwatchColor=RGB(0, 0, 0)),
    Shade=ColourSwatch(SwatchColor=RGBA(255, 255, 255, 0)),
    Grid=ColourSwatch(SwatchColor=RGBA(0, 0, 0, 0)))  # inputs Monochrome: Boolean, CanvasColour: Color, CanvasEdge: Color
# ---------- canvas_colours: Python ----------
import Grasshopper as gh

# Set background colour
gh.GUI.Canvas.GH_Skin.canvas_mono = Monochrome
if Monochrome:
    gh.GUI.Canvas.GH_Skin.canvas_mono_color = CanvasColour
else:
    gh.GUI.Canvas.GH_Skin.canvas_back = CanvasColour

# Other effects
gh.GUI.Canvas.GH_Skin.canvas_shade = Shade
gh.GUI.Canvas.GH_Skin.canvas_edge = CanvasEdge
gh.GUI.Canvas.GH_Skin.canvas_grid = Grid
# ---------- end canvas_colours ----------

trees = Mesh([<mesh referenced from the Rhino model> x193])
tin = Mesh(<mesh referenced from the Rhino model>)

trees_2 = Mesh(trees)
tin_2 = Mesh(tin)

volume = Volume(Geometry=trees_2)  # -> Volume, Centroid
expression = Expression(volume=volume.Volume, Expression="volume^(0.15)/4")
mesh_ray = MeshRay(Mesh=trees_2, Point=volume.Centroid, Direction=Vector(0, 0, -1))  # -> Point, Hit
mesh_ray_2 = MeshRay(Mesh=tin_2, Point=volume.Centroid, Direction=Vector(0, 0, -1))  # -> Point, Hit
line = Line(StartPoint=mesh_ray.Point, EndPoint=mesh_ray_2.Point)
mesh_pipe = MeshPipe(Curve=line, Radius=expression, Accuracy=0.2, Rotation=0, Segments=6, Caps=1)

tree_trunks = Mesh(mesh_pipe)
trees_3 = Mesh(trees)
tin_3 = Mesh(tin)
custom_preview = CustomPreview(Geometry=tree_trunks, Material=ColourSwatch(SwatchColor=RGB(112, 86, 58)))
custom_preview_2 = CustomPreview(Geometry=trees_3, Material=ColourSwatch(SwatchColor=RGB(145, 184, 86)))
custom_preview_3 = CustomPreview(Geometry=tin_3, Material=ColourSwatch(SwatchColor=RGB(222, 232, 172)))
